# Grasshopper definition OF1 _ grasshopper definition _ realeased on 23.07.2017.gh (Grasshopper 0.9.76)

incidence = Slider(0, range=-10..10)
ofset_a = Slider(27, range=0..100)
incidence_2 = Slider(0, range=-10..10)
length = Slider(420, range=0..800)
heigth = Slider(700, range=0..1000)
angle = Slider(74.8, range=60..130)
ofset_b_and_c = Slider(35.4, range=0..100)
division = Division(A=angle, B=2)
Y = UnitY(Factor=length)
Z = UnitZ(Factor=heigth)
pt = ConstructPoint(XCoordinate=Slider(500, range=0..1000), YCoordinate=Slider(0, range=0..1000), ZCoordinate=Slider(0, range=0..1000))
rad = Radians(Degrees=division)
# This work is distributed  by Openfoil in open source hardware.
# Author: Ludovic Regnault.
# Release: 23/07/2017.
input_profile = Geometry(<brep referenced from the Rhino model>)
rad_2 = Radians(Degrees=incidence)

# ---- group: Pt A
starting_pt = Point(pt)

# ----
rad_3 = Radians(Degrees=incidence_2)
xz = XZPlane(Origin=starting_pt)
yz = YZPlane(Origin=starting_pt)
xy = XYPlane(Origin=starting_pt)
yz_2 = Plane(yz)
xy_2 = Plane(xy)

# ---- group: Main angle
move = Move(Geometry=starting_pt, Motion=Z)  # -> Geometry, Transform
X = UnitX(Factor=1)
line = LineSDL(Start=move.Geometry, Direction=X, Length=1)
rotate = Rotate(Geometry=yz, Angle=rad, Plane=xz)  # -> Geometry, Transform
plx = LinePlane(Line=line, Plane=rotate.Geometry)  # -> Point, ParamL, ParamP

# ---- group: Main angle / Pt B
move_2 = Move(Geometry=plx.Point, Motion=Y)  # -> Geometry, Transform

# ---- group: Pt A
starting_pt_2 = Point(starting_pt)

# ---- group: Main angle / Pt A slided
move_3 = Move(Geometry=starting_pt_2, Motion=Y)  # -> Geometry, Transform

# ----
yz_3 = Plane(yz)
mirror = Mirror(Geometry=move_3.Geometry, Plane=yz_3)  # -> Geometry, Transform
mirror_2 = Mirror(Geometry=move_2.Geometry, Plane=yz_3)  # -> Geometry, Transform
vec2pt = Vector2Pt(PointA=mirror_2.Geometry, PointB=mirror.Geometry, Unitize=False)  # -> Vector, Length
vec2pt_2 = Vector2Pt(PointA=mirror_2.Geometry, PointB=starting_pt_2, Unitize=False)  # -> Vector, Length
vec2pt_3 = Vector2Pt(PointA=move_2.Geometry, PointB=move_3.Geometry, Unitize=False)  # -> Vector, Length
vec2pt_4 = Vector2Pt(PointA=move_2.Geometry, PointB=starting_pt_2, Unitize=False)  # -> Vector, Length

# ---- group: Pt C + Line BC
mirror_3 = Mirror(Geometry=move_2.Geometry, Plane=yz_3)  # -> Geometry, Transform
ln = Line(StartPoint=move_2.Geometry, EndPoint=mirror_3.Geometry)

# ----
vec = Vector(vec2pt_2.Vector)
vec_2 = Vector(vec2pt.Vector)
vec2pt_5 = Vector2Pt(PointA=move_2.Geometry, PointB=starting_pt_2, Unitize=False)  # -> Vector, Length
vec2pt_6 = Vector2Pt(PointA=move_3.Geometry, PointB=move_2.Geometry, Unitize=False)  # -> Vector, Length
vec_3 = Vector(vec2pt_4.Vector)
vec_4 = Vector(vec2pt_3.Vector)
vec2pt_7 = Vector2Pt(PointA=move_2.Geometry, PointB=mirror_3.Geometry, Unitize=False)  # -> Vector, Length

# ---- group: Lina AB(before slideof B)
ln_2 = Line(StartPoint=move_2.Geometry, EndPoint=move_3.Geometry)

# ---- group: Line AB
ln_3 = Line(StartPoint=move_2.Geometry, EndPoint=starting_pt_2)

# ----
dist = Distance(PointA=move_2.Geometry, PointB=mirror_3.Geometry)
width = Panel(dist)

num = Number(ofset_b_and_c)
eval = EvaluateLength(Curve=ln_2, Length=num, Normalized=False)  # -> Point, Tangent, Parameter
Y_2 = UnitY(Factor=1)
neg = Negative(Value=num)
line_2 = LineSDL(Start=eval.Point, Direction=Y_2, Length=neg)
ccx = CurveCurve(CurveA=line_2, CurveB=ln_3)  # -> Points, ParamsA, ParamsB
vec2pt_8 = Vector2Pt(PointA=eval.Point, PointB=ccx.Points, Unitize=False)  # -> Vector, Length
move_4 = Move(Geometry=ln, Motion=vec2pt_8.Vector)  # -> Geometry, Transform
eval_2 = EvaluateLength(Curve=move_4.Geometry, Length=num, Normalized=False)  # -> Point, Tangent, Parameter

vec_5 = Vector(vec2pt_5.Vector)
vec_6 = Vector(vec2pt_6.Vector)
vec_7 = Vector(vec2pt_7.Vector)

# ---- group: Ofset A + Slide of A / Line AB before slide of B
vec2pt_9 = Vector2Pt(PointA=plx.Point, PointB=starting_pt_2, Unitize=False)  # -> Vector, Length

# ---- group: Ofset A + Slide of A
end = EndPoints(Curve=ln_3)  # -> Start, End
ln_4 = Line(StartPoint=end.End, EndPoint=end.Start)
num_2 = Number(ofset_a)
eval_3 = EvaluateLength(Curve=ln_4, Length=num_2, Normalized=False)  # -> Point, Tangent, Parameter
line_3 = LineSDL(Start=eval_3.Point, Direction=vec2pt_9.Vector, Length=1)
plx_2 = LinePlane(Line=line_3, Plane=yz_3)  # -> Point, ParamL, ParamP

# ----
move_5 = Move(Geometry=move_2.Geometry, Motion=vec2pt_8.Vector)  # -> Geometry, Transform

# ---- group: Plane of wing in A
rotate_2 = Rotate(Geometry=rotate.Geometry, Angle=rad_3, Plane=yz_2)  # -> Geometry, Transform

# ----
pt_2 = Point(move_5.Geometry)
pt_3 = Point(plx_2.Point)
pt_4 = Point(eval_2.Point)
pt_5 = Point(ccx.Points)
vec_8 = Vector(vec)
vec_9 = Vector(vec_2)
vec_10 = Vector(vec_3)
vec_11 = Vector(vec_4)
neg_2 = Negative(Value=vec_10)
neg_3 = Negative(Value=vec_8)
vec_12 = Vector(neg_3)
vec_13 = Vector(vec_9)
vec_14 = Vector(vec_7)
neg_4 = Negative(Value=vec_14)
vec_15 = Vector(neg_2)
vec_16 = Vector(vec_11)
pt_6 = Point(<point referenced from the Rhino model>)
vec_exter_extru = Vector(neg_4)
xz_2 = Plane(xz)
vec_inter_extru = Vector(vec_14)
vdis = VectorDisplay(Anchor=pt_6, Vector=vec_15)
vdis_2 = VectorDisplay(Anchor=pt_6, Vector=vec_12)
vec_exter_extru_2 = Vector(vec_6)
vec_inter_extru_2 = Vector(vec_5)
pt_7 = Point(<point referenced from the Rhino model>)
vdis_3 = VectorDisplay(Anchor=pt_7, Vector=vec_inter_extru)
vdis_4 = VectorDisplay(Anchor=pt_7, Vector=vec_inter_extru_2)
loft_resolution = Slider(25, range=0..100)
_5_interior_extrusion_length = Slider(37, range=0..100)
_5_interior_extrusion_length_2 = Slider(35, range=0..100)
_6_start_tube = Slider(1, range=0..30)
_6_start_tube_2 = Slider(1, range=0..30)
_5_length_of_sph_part = Slider(8, range=0..50)
head_scrue_radius = Slider(9.5, range=0..20)
head_scrue_radius_2 = Slider(9.5, range=0..20)
_4_number_of_ring = Slider(6, range=0..10)
number_of_ring = Slider(6, range=0..10)
number_slider = Slider(5, range=0..10)
_3_radius = Slider(16, range=0..50)
radius_value = Number(_3_radius)
width_of_head = Slider(5, range=0..10)
width_of_head_2 = Slider(5, range=0..10)
f_void = Slider(0.4, range=0..3)
scrue_radius = Slider(5.4, range=0..10)
dist_1 = Slider(8, range=0..50)
scrue_radius_2 = Slider(5.4, range=0..10)
scrue_offset = Slider(4, range=0..10)
f_void_2 = Slider(0.4, range=0..3)
scrue_offset_2 = Slider(4, range=0..10)
_3_radius_2 = Slider(16, range=0..50)
angle_1 = Slider(28, range=0..60)
_1 = Slider(-90, range=-90..60)
_2 = Slider(0, range=-2..100)
slide_2 = Slider(16, range=0..100)
radius_value_2 = Number(_3_radius_2)
addition = Addition(A=radius_value, B=_6_start_tube)
addition_2 = Addition(A=radius_value_2, B=_6_start_tube_2)
number_slider_2 = Slider(50, range=0..100)
number_slider_3 = Slider(50, range=0..100)
pt_8 = ConstructPoint(XCoordinate=Slider(300, range=0..1000), YCoordinate=number_slider_2, ZCoordinate=0)
pt_9 = ConstructPoint(XCoordinate=Slider(400, range=0..1000), YCoordinate=number_slider_2, ZCoordinate=0)
pt_10 = ConstructPoint(XCoordinate=Slider(100, range=0..100), YCoordinate=number_slider_3, ZCoordinate=0)
pt_11 = ConstructPoint(XCoordinate=Slider(0, range=0..10), YCoordinate=number_slider_3, ZCoordinate=0)
xy_3 = XYPlane(Origin=pt_9)
xy_4 = XYPlane(Origin=pt_8)
xy_5 = XYPlane(Origin=pt_11)
xy_6 = XYPlane(Origin=pt_10)
flip_plane = FlipPlane(pln=xy_3)
flip_plane_2 = FlipPlane(pln=xy_4)
flip_plane_3 = FlipPlane(pln=xy_6)

pl_origin = PlaneOrigin(Base=xy_2, Origin=move_2.Geometry)
pl_origin_2 = PlaneOrigin(Base=yz_2, Origin=move_2.Geometry)
mirror_4 = Mirror(Geometry=rotate_2.Geometry, Plane=yz_2)  # -> Geometry, Transform

# ---- group: Plane of wing in B
rotate_3 = Rotate(Geometry=pl_origin, Angle=rad_2, Plane=pl_origin_2)  # -> Geometry, Transform

# ---- group: X Line between AB and AC
ppx = PlanePlane(PlaneA=rotate_2.Geometry, PlaneB=mirror_4.Geometry)

# ----
line_4 = Line(ppx)

pl_origin_3 = PlaneOrigin(Base=rotate_2.Geometry, Origin=rotate_3.Geometry)
cut_plane = CutPlane(B=ppx, O=eval_3.Point, P=rotate_2.Geometry)

# ---- group: X Line between AB and BC
ppx_2 = PlanePlane(PlaneA=rotate_3.Geometry, PlaneB=pl_origin_3)

# ----
line_5 = Line(ppx_2)

cut_plane_2 = CutPlane(B=ppx_2, O=eval_2.Point, P=rotate_3.Geometry)
mirror_5 = Mirror(Geometry=cut_plane_2, Plane=yz_2)  # -> Geometry, Transform
cut_plane_3 = CutPlane(B=ppx_2, O=ccx.Points, P=pl_origin_3)

pln_of_wing_bc = Plane(rotate_3.Geometry)
pi = Pi(Factor=1)
rotate_4 = Rotate(Geometry=pln_of_wing_bc, Angle=pi, Plane=pln_of_wing_bc)  # -> Geometry, Transform
pln_of_wing_ab = Plane(rotate_2.Geometry)
yz_4 = Plane(yz_2)
line_6 = Line(ln_3)
pln = Plane(mirror_5.Geometry)
pln_2 = Plane(cut_plane_2)
line_7 = Line(move_4.Geometry)
pln_3 = Plane(cut_plane_3)
pln_4 = Plane(cut_plane)
pln_of_wing_bc_2 = Plane(rotate_4.Geometry)
cluster = Cluster(pln=pln_3, pln_2=pln_4, pln_3=pln_of_wing_ab, line=line_6, G=input_profile)  # -> C, R, C_2
cluster_2 = Cluster(pln=pln, pln_2=pln_2, pln_3=pln_of_wing_bc_2, line=line_7, G=input_profile)  # -> C, R, C_2
mirror_6 = Mirror(Geometry=cluster.R, Plane=yz_4)  # -> Geometry, Transform
mirror_7 = Mirror(Geometry=cluster.C_2, Plane=yz_4)  # -> Geometry, Transform

mirror_8 = Mirror(Geometry=pln_4, Plane=yz_4)  # -> Geometry, Transform
pln_of_profile = Plane(pln_3)
pln_of_profile_2 = Plane(pln_2)
pln_of_profile_3 = Plane(pln_4)
pln_of_profile_4 = Plane(mirror_8.Geometry)
crv_profile = Curve(mirror_7.Geometry)
crv_profile_2 = Curve(cluster.C)
crv = Curve(cluster_2.C_2)
pln_5 = Plane(pln_4)
pln_6 = Plane(pln_2)
crv_2 = Curve(cluster.C_2)
pln_of_profile_5 = Plane(pln_of_profile)
pln_of_profile_6 = Plane(pln_of_profile_2)
pln_of_profile_7 = Plane(pln_of_profile_3)
pln_of_profile_8 = Plane(pln_of_profile_4)
cluster_3 = Cluster_10(
    crv=crv_profile_2,
    _5=_5_interior_extrusion_length,
    vec_inter_extru=vec_inter_extru_2,
    crv_2=crv,
    _5_2=_5_interior_extrusion_length,
    vec_inter_extru_2=vec_inter_extru,
    line_2=line_5,
    pt=pt_2,
    angle_of_possible_rotation=Slider(8, range=0..10),
    A=angle_1,
    L=slide_2,
    B=xz_2,
    radius=_3_radius_2,
    resolution_on_sphere=loft_resolution,
    arrondi_3=number_slider,
    resolution_on_tube=loft_resolution,
    arrondi_4=number_slider,
    arrondi=number_slider,
    arrondi_2=number_slider,
    bool=Slider(0, range=0..1),
    N=_4_number_of_ring,
    A_2=_5_length_of_sph_part,
    A_4=_5_length_of_sph_part,
    A_3=f_void_2,
    end_tube=radius_value_2,
    start_tube=addition_2,
    num=scrue_offset_2,
    num_3=head_scrue_radius,
    num_2=scrue_radius_2,
    A_5=width_of_head_2)  # -> R_2, R_3, R
cluster_4 = Cluster_10(
    crv=crv_profile,
    _5=_5_interior_extrusion_length_2,
    vec_inter_extru=vec_12,
    crv_2=crv_2,
    _5_2=_5_interior_extrusion_length_2,
    vec_inter_extru_2=vec_15,
    line_2=line_4,
    pt=pt_3,
    angle_of_possible_rotation=Slider(8, range=0..10),
    A=_1,
    L=_2,
    B=xz_2,
    radius=_3_radius,
    resolution_on_sphere=loft_resolution,
    arrondi_3=Slider(0.5, range=0..1),
    resolution_on_tube=loft_resolution,
    arrondi_4=Slider(0.5, range=0..1),
    arrondi=Slider(0.5, range=0..1),
    arrondi_2=Slider(0.5, range=0..1),
    bool=Slider(1, range=0..1),
    N=number_of_ring,
    A_2=dist_1,
    A_4=dist_1,
    A_3=f_void,
    end_tube=radius_value,
    start_tube=addition,
    num=scrue_offset,
    num_3=head_scrue_radius_2,
    num_2=scrue_radius,
    A_5=width_of_head)  # -> R_2, R_3, R
brep = Brep(flatten(cluster_3.R_2))
brep_2 = Brep(flatten(cluster_3.R_3))
scrue = Brep(cluster_3.R)
geo = Geometry([cluster.R, cluster_2.R, mirror_6.Geometry])
brep_3 = Brep(cluster_4.R_2)
brep_4 = Brep(cluster_4.R_3)
scrue_2 = Brep(cluster_4.R)
pln_of_profile_9 = Plane(pln_of_profile_6)
pln_of_profile_10 = Plane(pln_of_profile_5)
pln_of_profile_11 = Plane(pln_of_profile_7)
pln_of_profile_12 = Plane(pln_of_profile_8)
mirror_9 = Mirror(Geometry=brep, Plane=yz_4)  # -> Geometry, Transform
mirror_10 = Mirror(Geometry=brep_2, Plane=yz_4)  # -> Geometry, Transform
mirror_11 = Mirror(Geometry=scrue, Plane=yz_4)  # -> Geometry, Transform
orient = Orient(Geometry=brep, Source=pln_of_profile_10, Target=flip_plane)  # -> Geometry, Transform
orient_2 = Orient(Geometry=brep_2, Source=pln_of_profile_9, Target=flip_plane_2)  # -> Geometry, Transform
orient_3 = Orient(Geometry=brep_4, Source=pln_of_profile_11, Target=xy_5)  # -> Geometry, Transform
orient_4 = Orient(Geometry=brep_3, Source=pln_of_profile_12, Target=flip_plane_3)  # -> Geometry, Transform

# ==== cluster CutPlane
P = ClusterInput()
deplane = DeconstructPlane(Plane=P)  # -> Origin, XAxis, YAxis, ZAxis
line = LineSDL(Start=deplane.Origin, Direction=deplane.ZAxis, Length=1)
B = ClusterInput()
lnln = LineLine(LineA=line, LineB=B)
O = ClusterInput()
pl_origin = PlaneOrigin(Base=lnln, Origin=O)
pl = ClusterOutput(pl_origin)

# ==== cluster Cluster
pln = ClusterInput()
pln_2 = ClusterInput()
line = ClusterInput()
pln_3 = ClusterInput()
pln_4 = Plane(pln)
pln_5 = Plane(pln_2)
line_2 = Line(line)
pln_6 = Plane(pln_3)
xy = XYPlane(Origin=Point(0, 0, 0))
G = ClusterInput()
end = EndPoints(Curve=line_2)  # -> Start, End
geo = Geometry(G)
deplane = DeconstructPlane(Plane=pln_5)  # -> Origin, XAxis, YAxis, ZAxis
deplane_2 = DeconstructPlane(Plane=pln_4)  # -> Origin, XAxis, YAxis, ZAxis
pl = PlaneNormal(Origin=end.Start, ZAxis=line_2)
pl_origin = PlaneOrigin(Base=pln_6, Origin=pl)
neg = Negative(Value=deplane_2.YAxis)
neg_2 = Negative(Value=deplane.YAxis)
vec2pt = Vector2Pt(PointA=end.End, PointB=end.Start, Unitize=False)  # -> Vector, Length
ppx = PlanePlane(PlaneA=pl_origin, PlaneB=pl)
number_slider = Slider(1000, range=0..1000)
move = Move(Geometry=pln_4, Motion=neg)  # -> Geometry, Transform
move_2 = Move(Geometry=pln_5, Motion=neg_2)  # -> Geometry, Transform
align = AlignPlane(Plane=pl, Direction=ppx)  # -> Plane, Angle
multiplication = Multiplication(A=vec2pt.Vector, B=Slider(-3, range=-10..10))
move_3 = Move(Geometry=align.Plane, Motion=vec2pt.Vector)  # -> Geometry, Transform
dom = ConstructDomain(DomainStart=Slider(-1000, range=-1000..1000), DomainEnd=number_slider)
orient = Orient(Geometry=G, Source=xy, Target=move_3.Geometry)  # -> Geometry, Transform
planesrf = PlaneSurface(Plane=move_2.Geometry, XSize=dom, YSize=number_slider)
planesrf_2 = PlaneSurface(Plane=move.Geometry, XSize=dom, YSize=number_slider)
extr = Extrude(Base=orient.Geometry, Direction=multiplication)
sec = BrepPlane(Brep=extr, Plane=pln_4)  # -> Curves, Points
sec_2 = BrepPlane(Brep=extr, Plane=pln_5)  # -> Curves, Points
C = ClusterOutput(sec.Curves)
C_2 = ClusterOutput(sec_2.Curves)
blendbox = BlendBox(SurfaceA=planesrf_2, DomainA=planesrf_2, SurfaceB=planesrf, DomainB=planesrf)
sint = SolidIntersection(BrepsA=blendbox, BrepsB=extr)
R = ClusterOutput(sint)

# ==== cluster Cluster_10
A = ClusterInput()
pt = ClusterInput()
B = ClusterInput()
pt_2 = Point(pt)

# ---- group: 1
addition = Addition(A=A, B=Slider(90, range=0..100))
line = LineSDL(Start=pt_2, Direction=Vector(0, 0, 1), Length=Slider(100, range=0..100))
neg = Negative(Value=addition)
pl_origin = PlaneOrigin(Base=B, Origin=pt_2)
rad = Radians(Degrees=neg)
rotate = Rotate(Geometry=line, Angle=rad, Plane=pl_origin)  # -> Geometry, Transform

# ----
line_2 = ClusterInput()
line_3 = Line(line_2)
L = ClusterInput()
radius = ClusterInput()

# ---- group: 2
eval = EvaluateLength(Curve=rotate.Geometry, Length=L, Normalized=False)  # -> Point, Tangent, Parameter

# ----
radius_2 = Number(radius)
radius_3 = Number(radius_2)

# ---- group: build halh sphere
pt_3 = ConstructPoint(XCoordinate=0, YCoordinate=0, ZCoordinate=0)
Y = UnitY(Factor=1)
circle = CircleCNR(Center=pt_3, Normal=Y, Radius=radius_3)
sph = Sphere(Base=PlaneXY(0, 0, 0), Radius=radius_3)
srfsplit = SurfaceSplit(Surface=sph, Curves=circle)
xz = XZPlane(Origin=Point(0, 0, 0))
item = ListItem(List=srfsplit, Index=1, Wrap=True)
item_2 = ListItem(List=srfsplit, Index=0, Wrap=True)

# ----
A_2 = ClusterInput()
A_3 = ClusterInput()
A_4 = ClusterInput()
vec_inter_extru = ClusterInput()
crv = ClusterInput()
_5 = ClusterInput()
num = ClusterInput()
num_2 = ClusterInput()
num_3 = ClusterInput()
crv_2 = ClusterInput()
_5_2 = ClusterInput()
vec_inter_extru_2 = ClusterInput()
num_4 = Number(num)
num_5 = Number(num_2)
num_6 = Number(num_3)
cluster = Cluster_7(_5=_5_2, vec_inter_extru=vec_inter_extru_2, crv=crv_2)  # -> R, E
cluster_2 = Cluster_7(_5=_5, vec_inter_extru=vec_inter_extru, crv=crv)  # -> R, E
line_4 = Line(line_3)
pt_4 = Point(eval.Point)
A_5 = ClusterInput()
end = EndPoints(Curve=line_4)  # -> Start, End
vec2pt = Vector2Pt(PointA=end.Start, PointB=end.End, Unitize=False)  # -> Vector, Length
vec = Vector(vec2pt.Vector)
amp = Amplitude(Vector=vec, Amplitude=A_2)
amp_2 = Amplitude(Vector=vec, Amplitude=A_4)

# ---- group: space between
amp_3 = Amplitude(Vector=vec, Amplitude=A_3)

# ----
neg_2 = Negative(Value=amp)

# ---- group: end of profiles
cluster_3 = Cluster_8(C_2=cluster.R, C=line_4, Z=line_4)  # -> H, L
cluster_4 = Cluster_8(C_2=cluster_2.R, C=line_4, Z=line_4)  # -> H, L

# ----
resolution_on_tube = ClusterInput()
resolution_on_sphere = ClusterInput()
line_5 = LineSDL(Start=pt_4, Direction=vec2pt.Vector, Length=1000)
ln = Line(StartPoint=cluster_3.H, EndPoint=cluster_3.L)
ln_2 = Line(StartPoint=cluster_4.H, EndPoint=cluster_4.L)
crv_cp = CurveClosestPoint(Point=cluster_3.H, Curve=line_5)  # -> Point, Parameter, Distance
crv_cp_2 = CurveClosestPoint(Point=cluster_4.H, Curve=line_5)  # -> Point, Parameter, Distance
crv_cp_3 = CurveClosestPoint(Point=cluster_4.L, Curve=line_5)  # -> Point, Parameter, Distance
resolution_on_sphere_2 = Number(resolution_on_sphere)
resolution_on_tube_2 = Number(resolution_on_tube)
radius_4 = Number(radius_2)

# ---- group: middle rings / dist of extrusion
space_between_elements = Vector(amp_3)

# ---- group: for axis of profiles
ln_3 = Line(StartPoint=crv_cp_3.Point, EndPoint=crv_cp.Point)
ln_4 = Line(StartPoint=crv_cp_3.Point, EndPoint=crv_cp_2.Point)

# ---- group: Select the longest
line_6 = Line([ln_4, ln_3])
len = Length(Curve=line_6)
sort = SortList(Keys=len, ValuesA=line_6)  # -> Keys, ValuesA
item_3 = ListItem(List=sort.ValuesA, Index=-1, Wrap=True)

# ---- group: for axis of tube
line_7 = Line(item_3)

# ----
end_tube = ClusterInput()
start_tube = ClusterInput()
start_tube_2 = Number(start_tube)
for_tube_axis = Line(line_7)
end_tube_2 = Number(end_tube)
modify_ln_length = ModifyLnLength(C=for_tube_axis, A_2=end_tube_2, A=start_tube_2)
tube_axis = Line(modify_ln_length)

end_2 = EndPoints(Curve=tube_axis)  # -> Start, End
pl = PlaneNormal(Origin=end_2.End, ZAxis=tube_axis)
pl_2 = PlaneNormal(Origin=end_2.Start, ZAxis=tube_axis)

# ---- group: PIPE
pipe = Pipe(Curve=tube_axis, Radius=radius_3, Caps=0)

# ----
orient = Orient(Geometry=item, Source=xz, Target=pl)  # -> Geometry, Transform
orient_2 = Orient(Geometry=item_2, Source=xz, Target=pl_2)  # -> Geometry, Transform
join = BrepJoin(Breps=flatten([pipe, orient_2.Geometry, orient.Geometry]))  # -> Breps, Closed
tube = Geometry(join.Breps)

# ---- group: Scrues
subtraction = Subtraction(A=num_6, B=Slider(0.05, range=0..0.1))
subtraction_2 = Subtraction(A=num_5, B=Slider(0.05, range=0..0.1))
cluster_5 = Cluster_5(vec=vec, A=num_4, A_2=radius_2, pt_2=end_2.End, pt=end_2.Start, num=num_6, R=num_5)
cluster_6 = Cluster_5(vec=vec, A=num_4, A_2=A_5, pt_2=end_2.End, pt=end_2.Start, num=subtraction, R=subtraction_2)

# ----
move = Move(Geometry=end_2.End, Motion=neg_2)  # -> Geometry, Transform
move_2 = Move(Geometry=end_2.Start, Motion=amp_2)  # -> Geometry, Transform
ln_5 = Line(StartPoint=move.Geometry, EndPoint=move_2.Geometry)
R = ClusterOutput(cluster_6)

# ---- group: middle rings
line_8 = Line(ln_5)
N = ClusterInput()

# ----
tube_axis_2 = Line(tube_axis)
tube_2 = Geometry(tube)

# ---- group: middle rings / Place planes
divide = DivideCurve(Curve=line_8, Count=N, Kinks=False)  # -> Points, Tangents, Parameters
pl_3 = PlaneNormal(Origin=eval.Point, ZAxis=vec)
pl_origin_2 = PlaneOrigin(Base=pl_3, Origin=divide.Points)

# ----
geo = Geometry(pl_origin_2)
cull = CullPattern(List=geo, CullPattern=[False, True])
cull_2 = CullPattern(List=geo, CullPattern=[True, False])
cull_3 = CullPattern(List=geo, CullPattern=[False, True])
cull_4 = CullPattern(List=geo, CullPattern=[True, False])
move_3 = Move(Geometry=cull, Motion=space_between_elements)  # -> Geometry, Transform
move_4 = Move(Geometry=cull_4, Motion=space_between_elements)  # -> Geometry, Transform
weave = Weave(Pattern=[0, 1], Stream0=cull_2, Stream1=move_3.Geometry, NullGaps=False)
weave_2 = Weave(Pattern=[0, 1], Stream0=move_4.Geometry, Stream1=cull_3, NullGaps=False)
discs = Geometry(weave_2)
discs_2 = Geometry(weave)

line_9 = Line(ln_3)  # disabled
line_10 = Line(ln_4)  # disabled
arrondi = ClusterInput()  # disabled
arrondi_2 = ClusterInput()  # disabled
arrondi_3 = ClusterInput()  # disabled
arrondi_4 = ClusterInput()  # disabled
arrondi_5 = Number(arrondi)  # disabled
arrondi_6 = Number(arrondi_2)  # disabled
arrondi_7 = Number(arrondi_3)  # disabled
arrondi_8 = Number(arrondi_4)  # disabled
modify_ln_length_2 = ModifyLnLength(C=line_10, A_2=arrondi_7, A=arrondi_8)  # disabled
modify_ln_length_3 = ModifyLnLength(C=line_9, A_2=arrondi_5, A=arrondi_6)  # disabled
axis_1 = Line(modify_ln_length_2)  # disabled
axis_2 = Line(modify_ln_length_3)  # disabled

bool = ClusterInput()
bool_2 = Boolean(bool)
bool_3 = Boolean(invert(bool_2))
filter = StreamFilter(Gate=bool_2, Stream0=discs_2, Stream1=discs)
filter_2 = StreamFilter(Gate=bool_3, Stream0=discs_2, Stream1=discs)
line_11 = Line(ln)
line_12 = Line(ln_2)
crv_3 = Curve(cluster_2.R)
crv_4 = Curve(cluster.R)
discs_1 = Geometry(filter)
discs_2_2 = Geometry(filter_2)
angle_of_possible_rotation = ClusterInput()
manchon = Manchon(
    profile_axis=axis_2,
    tube_axis=tube_axis_2,
    tube=tube_2,
    profile=crv_4,
    line_of_extrem_on_profile=line_11,
    radius=radius_4,
    resolution_on_tube=resolution_on_tube_2,
    resolution_on_sphere=resolution_on_sphere_2)  # -> C, poing_rentrant_2, poing_sortant_2, B
manchon_2 = Manchon(
    profile_axis=axis_1,
    tube_axis=tube_axis_2,
    tube=tube_2,
    profile=crv_3,
    line_of_extrem_on_profile=line_12,
    radius=radius_4,
    resolution_on_tube=resolution_on_tube_2,
    resolution_on_sphere=resolution_on_sphere_2)  # -> C, poing_rentrant_2, poing_sortant_2, B
angle_of_possible_rotation_2 = Number(angle_of_possible_rotation)
tube_axis_3 = Line(tube_axis_2)
poing_rentrant_2 = Geometry(manchon.poing_rentrant_2)
poing_rentrant_1 = Geometry(manchon_2.poing_rentrant_2)
loft_1 = Brep(manchon_2.B)
tube_3 = Geometry(tube)
loft_2 = Brep(manchon.B)
neg_3 = Negative(Value=angle_of_possible_rotation_2)
cut_poing_rentrant = CutPoingRentrant(
    D=neg_3,
    X=tube_axis_3,
    G=loft_2,
    poing_rentrant_2=poing_rentrant_1,
    loft_2=loft_1,
    tube=tube_3,
    poing_rentrant_1=poing_rentrant_2)
cut_poing_rentrant_2 = CutPoingRentrant(
    D=angle_of_possible_rotation_2,
    X=tube_axis_3,
    G=loft_1,
    poing_rentrant_2=poing_rentrant_2,
    loft_2=loft_2,
    tube=tube_3,
    poing_rentrant_1=poing_rentrant_1)
poing_sortant = Geometry(manchon_2.poing_sortant_2)
poing_sortant_2 = Geometry(manchon.poing_sortant_2)
pt_5 = Point(end_2.Start)
discs_1_2 = Geometry(discs_1)
discs_2_3 = Geometry(discs_2_2)
bool_4 = Boolean(bool)
bool_5 = Boolean(invert(bool_4))
combine_poings = CombinePoings(discs=discs_1_2, brep=poing_sortant, brep_2=cut_poing_rentrant, bool=bool_4, starting_point=pt_5)
combine_poings_2 = CombinePoings(discs=discs_2_3, brep=poing_sortant_2, brep_2=cut_poing_rentrant_2, bool=bool_5, starting_point=pt_5)
brep = Brep(flatten(cluster_2.E))
brep_2 = Brep(flatten(cluster.E))
brep_3 = Brep(combine_poings)
brep_4 = Brep(combine_poings_2)
cluster_7 = Cluster_9(geo=brep, B=brep_3)
cluster_8 = Cluster_9(geo=brep_2, B=brep_4)
brep_5 = Brep(cluster_8)
brep_6 = Brep(cluster_7)
brep_7 = Brep(cluster_5)
brep_8 = Brep(brep_6)
brep_9 = Brep(brep_5)
sdiff = SolidDifference(BrepsA=brep_8, BrepsB=brep_7)
sdiff_2 = SolidDifference(BrepsA=brep_9, BrepsB=brep_7)
R_2 = ClusterOutput(sdiff)
R_3 = ClusterOutput(sdiff_2)

# ==== cluster FlipPlane
pln = ClusterInput()
pln_2 = Plane(pln)
deplane = DeconstructPlane(Plane=pln_2)  # -> Origin, XAxis, YAxis, ZAxis
pi = Pi(Factor=1)
rot3d = Rotate3D(Geometry=pln_2, Angle=pi, Center=deplane.Origin, Axis=deplane.YAxis)  # -> Geometry, Transform
G = ClusterOutput(rot3d.Geometry)

# ==== cluster Manchon
resolution_on_tube = ClusterInput()
line_of_extrem_on_profile = ClusterInput()
resolution_on_tube_2 = Number(resolution_on_tube)
profile = ClusterInput()
line_of_extrem_on_profile_2 = Line(line_of_extrem_on_profile)
end = EndPoints(Curve=line_of_extrem_on_profile_2)  # -> Start, End
profile_2 = Curve(profile)
crv_cp = CurveClosestPoint(Point=[end.Start, end.End], Curve=profile_2)  # -> Point, Parameter, Distance
shatter = Shatter(Curve=profile_2, Parameters=crv_cp.Parameter)
profile_axis = ClusterInput()
tube_axis = ClusterInput()

# ---- group: chose 1 of 2
cull = CullPattern(List=shatter, CullPattern=[True, False])
cull_2 = CullPattern(List=shatter, CullPattern=[False, True])

# ----
tube_axis_2 = Line(tube_axis)
tube_axis_3 = Line(tube_axis_2)
profile_axis_2 = Line(profile_axis)
radius = ClusterInput()
tube = ClusterInput()

# ---- group: average middle
eval = EvaluateCurve(Curve=profile_axis_2, Parameter=0.5)  # -> Point, Tangent, Angle; disabled
eval_2 = EvaluateCurve(Curve=tube_axis_3, Parameter=0.5)  # -> Point, Tangent, Angle; disabled
ln = Line(StartPoint=eval.Point, EndPoint=eval_2.Point)  # disabled
eval_3 = EvaluateCurve(Curve=ln, Parameter=0.5)  # -> Point, Tangent, Angle; disabled

# ----
tube_2 = Geometry(tube)

# ---- group: Create shortest axis
end_2 = EndPoints(Curve=tube_axis_3)  # -> Start, End; disabled
end_3 = EndPoints(Curve=profile_axis_2)  # -> Start, End; disabled
pl = PlaneNormal(Origin=[end_3.Start, end_3.End], ZAxis=profile_axis_2)  # disabled
pl_2 = PlaneNormal(Origin=[end_2.Start, end_2.End], ZAxis=tube_axis_3)  # disabled
plx = LinePlane(Line=tube_axis_3, Plane=pl)  # -> Point, ParamL, ParamP; disabled
plx_2 = LinePlane(Line=profile_axis_2, Plane=pl_2)  # -> Point, ParamL, ParamP; disabled
sort_pt = SortPoints(Points=[plx_2.Point, plx.Point])  # -> Points, Indices; disabled
cull_3 = CullPattern(List=sort_pt.Indices, CullPattern=[True, False, False, True])  # disabled
item = ListItem(List=sort_pt.Points, Index=cull_3, Wrap=True)  # disabled
cull_4 = CullPattern(List=item, CullPattern=[True, False])  # disabled
cull_5 = CullPattern(List=item, CullPattern=[False, True])  # disabled
ln_2 = Line(StartPoint=cull_5, EndPoint=cull_4)  # disabled

# ----
radius_2 = Number(radius)
tube_axis_4 = Line(tube_axis)
divide = DivideCurve(Curve=tube_axis_4, Count=resolution_on_tube_2, Kinks=False)  # -> Points, Tangents, Parameters

# ---- group: Used line
number_slider = Slider(2, range=0..10)  # disabled
pt = Point([plx_2.Point, plx.Point])  # disabled
cps = ClosestPoints(Point=eval_3.Point, Cloud=pt, Count=number_slider)  # -> ClosestPoint, CPIndex, Distance; disabled
pt_2 = Point(cps.ClosestPoint)  # disabled
cull_6 = CullPattern(List=pt_2, CullPattern=[True, False])  # disabled
cull_7 = CullPattern(List=pt_2, CullPattern=[False, True])  # disabled
ln_3 = Line(StartPoint=cull_7, EndPoint=cull_6)  # disabled

# ----
pl_3 = PlaneNormal(Origin=divide.Points, ZAxis=tube_axis_3)
radius_3 = Number(radius_2)
brep = Brep(tube_2)

# ---- group: choose up part or down part / plane with inclinaison of line of extreme
X = UnitX(Factor=1)
line_of_extrem_on_profile_3 = Line(line_of_extrem_on_profile_2)
end_4 = EndPoints(Curve=line_of_extrem_on_profile_3)  # -> Start, End
line = LineSDL(Start=end_4.Start, Direction=X, Length=1)
xy = XYPlane(Origin=end_4.Start)
lnln = LineLine(LineA=line, LineB=line_of_extrem_on_profile_3)

# ----
pcx = CurvePlane(Curve=cull_2, Plane=pl_3)  # -> flatten(Points), ParamsC, ParamsP
pcx_2 = CurvePlane(Curve=cull, Plane=pl_3)  # -> flatten(Points), ParamsC, ParamsP
cir = Circle(Plane=pl_3, Radius=radius_3)
pln = Plane(lnln)
geo = Geometry(pcx_2.Points)
geo_2 = Geometry(pcx.Points)

# ---- group: choose up part or down part
item_2 = ListItem(List=pcx.Points, Index=0, Wrap=True)
cp = PlaneClosestPoint(Point=item_2, Plane=pln)  # -> Point, UVPoint, Distance
smaller = SmallerThan(FirstNumber=cp.Distance, SecondNumber=0)  # -> SmallerThan, OrEqualTo
larger = LargerThan(FirstNumber=cp.Distance, SecondNumber=0)  # -> LargerThan, OrEqualTo
bool = Boolean(invert(larger.LargerThan))
bool_2 = Boolean(invert(smaller.SmallerThan))
cull_8 = CullPattern(List=geo, CullPattern=bool)
cull_9 = CullPattern(List=geo_2, CullPattern=larger.LargerThan)
cull_10 = CullPattern(List=geo, CullPattern=bool_2)
cull_11 = CullPattern(List=geo_2, CullPattern=smaller.SmallerThan)
up = Point([cull_9, cull_8])
down = Point([cull_11, cull_10])

# ---- group: Select end points
lng = ListLength(List=down)
lng_2 = ListLength(List=up)
subtraction = Subtraction(A=lng, B=1)
subtraction_2 = Subtraction(A=lng_2, B=1)
item_3 = ListItem(List=up, Index=Slider(0, range=0..100), Wrap=True)
item_4 = ListItem(List=down, Index=Slider(0, range=0..100), Wrap=True)
item_5 = ListItem(List=up, Index=subtraction, Wrap=True)
item_6 = ListItem(List=down, Index=subtraction_2, Wrap=True)

# ----
tube_axis_5 = Line(tube_axis_2)
resolution_on_sphere = ClusterInput()
end_5 = EndPoints(Curve=tube_axis_5)  # -> Start, End
profile_axis_3 = Line(tube_axis_5)
pt_3 = Point(end_5.Start)
pt_4 = Point(end_5.End)
resolution_on_sphere_2 = Number(resolution_on_sphere)
eval_4 = EvaluateCurve(Curve=profile_axis_3, Parameter=0.5)  # -> Point, Tangent, Angle

# ---- group: Pline Sphere
ln_4 = Line(StartPoint=item_3, EndPoint=item_4)
ln_5 = Line(StartPoint=item_5, EndPoint=item_6)
line_2 = Line(ln_3)  # disabled
end_6 = EndPoints(Curve=line_2)  # -> Start, End; disabled
pt_5 = Point(end_6.Start)  # disabled
line_3 = Line(ln_4)
profile_3 = Curve(profile_2)
pt_6 = Point(end_6.End)  # disabled
line_4 = Line(ln_5)
cluster = Cluster_2(pt=pt_3, C=line_3, num=resolution_on_sphere_2, radius=radius_2, crv=profile_3, S=eval_4.Point)  # -> S_2, shatter_pts_2, crv_profile_2
cluster_2 = Cluster_2(pt=pt_4, C=line_4, num=resolution_on_sphere_2, radius=radius_2, crv=profile_3, S=eval_4.Point)  # -> S_2, shatter_pts_2, crv_profile_2

# ----
curve_3 = Geometry(cluster_2.S_2)
curve_4 = Geometry(cluster.S_2)
partitioned_loft = PartitionedLoft(
    from_curve_on_tube=cluster_2.S_2,
    from_select_part_of_profile=cluster_2.crv_profile_2,
    shatter_pt=cluster_2.shatter_pts_2)
partitioned_loft_2 = PartitionedLoft(from_curve_on_tube=cluster.S_2, from_select_part_of_profile=cluster.crv_profile_2, shatter_pt=cluster.shatter_pts_2)
curve_3_2 = Geometry(curve_3)
curve_4_2 = Geometry(curve_4)
tube_3 = Geometry(tube_2)
tube_4 = Geometry(tube_3)
debrep = DeconstructBrep(Brep=tube_4)  # -> Faces, Edges, Vertices
item_7 = ListItem(List=debrep.Faces, Index=1, Wrap=True)
item_8 = ListItem(List=debrep.Faces, Index=2, Wrap=True)
item_9 = ListItem(List=debrep.Faces, Index=0, Wrap=True)
extr_tube = Geometry(item_8)
half_sph_1 = Brep(item_9)
half_sph_2 = Brep(item_7)

# ---- group: choose tangents which are the most separated
tan = TangentLines(Point=flatten(up), Circle=flatten(cir))  # -> Tangent1, Tangent2
tan_2 = TangentLines(Point=flatten(down), Circle=flatten(cir))  # -> Tangent1, Tangent2
geo_3 = Geometry(tan_2.Tangent2)
geo_4 = Geometry(tan_2.Tangent1)
geo_5 = Geometry(tan.Tangent1)
geo_6 = Geometry(tan.Tangent2)
item_10 = ListItem(List=geo_3, Index=0, Wrap=True)
item_11 = ListItem(List=geo_5, Index=0, Wrap=True)
item_12 = ListItem(List=geo_6, Index=0, Wrap=True)
item_13 = ListItem(List=geo_4, Index=0, Wrap=True)
line_5 = Line([item_11, item_12, item_13, item_10])
end_7 = EndPoints(Curve=line_5)  # -> Start, End
pt_7 = Point(end_7.End)
line_6 = Line(line_5)
geo_7 = Geometry(geo_3)
geo_8 = Geometry(geo_4)
geo_9 = Geometry(geo_5)
geo_10 = Geometry(geo_3)
geo_11 = Geometry(geo_6)
geo_12 = Geometry(geo_4)
geo_13 = Geometry(geo_5)
geo_14 = Geometry(geo_6)

# ---- group: choose tangents which are the most separated / farthest points
prox = Proximity3D(Points=pt_7, Group=3)  # -> flatten(Links), Topology
len = Length(Curve=prox.Links)
sort = SortList(Keys=len, ValuesA=prox.Links)  # -> Keys, ValuesA
item_14 = ListItem(List=sort.ValuesA, Index=-1, Wrap=True)
end_8 = EndPoints(Curve=item_14)  # -> Start, End

# ---- group: choose tangents which are the most separated (continued)
pt_8 = Point([end_8.Start, end_8.End])
crv_cp_2 = CurveClosestPoint(Point=end_8.End, Curve=line_6)  # -> Point, Parameter, Distance
equals = Equality(FirstNumber=crv_cp_2.Distance, SecondNumber=0)  # -> Equality, Inequality
crv_cp_3 = CurveClosestPoint(Point=end_8.Start, Curve=line_6)  # -> Point, Parameter, Distance
equals_2 = Equality(FirstNumber=crv_cp_3.Distance, SecondNumber=0)  # -> Equality, Inequality
item_15 = ListItem(List=equals_2.Equality, Index=Slider(0, range=0..100), Wrap=True)
item_16 = ListItem(List=equals.Equality, Index=Slider(0, range=0..100), Wrap=True)
item_17 = ListItem(List=equals_2.Equality, Index=Slider(2, range=0..100), Wrap=True)
item_18 = ListItem(List=equals.Equality, Index=Slider(2, range=0..100), Wrap=True)
item_19 = ListItem(List=equals_2.Equality, Index=Slider(1, range=0..100), Wrap=True)
item_20 = ListItem(List=equals_2.Equality, Index=Slider(3, range=0..100), Wrap=True)
item_21 = ListItem(List=equals.Equality, Index=Slider(1, range=0..100), Wrap=True)
item_22 = ListItem(List=equals.Equality, Index=Slider(3, range=0..100), Wrap=True)
cull_12 = CullPattern(List=geo_8, CullPattern=item_17)
cull_13 = CullPattern(List=geo_12, CullPattern=item_18)
cull_14 = CullPattern(List=geo_11, CullPattern=item_19)
cull_15 = CullPattern(List=geo_9, CullPattern=item_15)
cull_16 = CullPattern(List=geo_7, CullPattern=item_20)
cull_17 = CullPattern(List=geo_14, CullPattern=item_21)
cull_18 = CullPattern(List=geo_13, CullPattern=item_16)
cull_19 = CullPattern(List=geo_10, CullPattern=item_22)
line_7 = Line([cull_15, cull_14])
line_8 = Line([cull_12, cull_16])
line_9 = Line([cull_18, cull_17])
line_10 = Line([cull_13, cull_19])
line_11 = Line([line_7, line_9])
line_12 = Line([line_10, line_8])

# ---- group: Pline on tube
profile_4 = Curve(profile_2)
tube_axis_6 = Line(tube_axis_3)
tube_5 = Geometry(tube_2)
select_part_of_profile = SelectPartOfProfile(crv=profile_4, P=[item_6, item_4])
select_part_of_profile_2 = SelectPartOfProfile(crv=profile_4, P=[item_5, item_3])
curve_on_tube = CurveOnTube(C=line_12, C_2=tube_axis_6, B=tube_5)
curve_on_tube_2 = CurveOnTube(C=line_11, C_2=tube_axis_6, B=tube_5)

# ---- group: Loft
shatter_pt = Point(pcx_2.Points)
shatter_pt_2 = Point(pcx.Points)
partitioned_loft_3 = PartitionedLoft(from_curve_on_tube=curve_on_tube_2, from_select_part_of_profile=select_part_of_profile_2, shatter_pt=shatter_pt_2)
partitioned_loft_4 = PartitionedLoft(from_curve_on_tube=curve_on_tube, from_select_part_of_profile=select_part_of_profile, shatter_pt=shatter_pt)

# ----
geo_15 = Geometry(curve_on_tube_2)
geo_16 = Geometry(curve_on_tube)
join = JoinCurves(Curves=geo_16, Preserve=False)
join_2 = JoinCurves(Curves=geo_15, Preserve=False)
curve_1 = Geometry(join_2)
curve_2 = Geometry(join)

# ---- group: Lofts
join_3 = BrepJoin(Breps=[partitioned_loft_3, partitioned_loft_4, partitioned_loft, partitioned_loft_2])  # -> Breps, Closed

# ----
B = ClusterOutput(join_3.Breps)
loft = Geometry(join_3.Breps)
curve_1_2 = Geometry(curve_1)
curve_2_2 = Geometry(curve_2)

# ---- group: Curves
join_4 = JoinCurves(Curves=flatten([cluster_2.S_2, cluster.S_2, curve_1_2, curve_2_2]), Preserve=False)  # -> flatten(Curves)

# ----
C = ClusterOutput(join_4)
curve_1_3 = Geometry(curve_1)
curve_2_3 = Geometry(curve_2)
crv = Curve(flatten([curve_1_3, curve_2_3, curve_3_2, curve_4_2]))
join_5 = JoinCurves(Curves=crv, Preserve=False)
crv_2 = Curve(join_5)
fn_curve = Curve(crv_2)
srfsplit = SurfaceSplit(Surface=extr_tube, Curves=fn_curve)
join_broken_parts = JoinBrokenParts(fp_curve=fn_curve, brep=srfsplit)  # -> B, B_2

brep_2 = Brep(graft(join_broken_parts.B))
brep_3 = Brep(graft(join_broken_parts.B_2))
area = Area(Geometry=[brep_3, brep_2])  # -> Area, Centroid
sort_2 = SortList(Keys=area.Area, ValuesA=[brep_2, brep_3])  # -> Keys, ValuesA
item_23 = ListItem(List=sort_2.ValuesA, Index=1, Wrap=True)
item_24 = ListItem(List=sort_2.ValuesA, Index=0, Wrap=True)

fp_curve = Curve(crv_2)
cluster_3 = Cluster_4(S=half_sph_1, C=fp_curve)  # -> smallest_2, biggest_2
cluster_4 = Cluster_4(S=half_sph_2, C=fp_curve)  # -> smallest_2, biggest_2
geo_17 = Geometry(cluster_3.biggest_2)
geo_18 = Geometry(cluster_4.biggest_2)
geo_19 = Geometry(cluster_3.smallest_2)
geo_20 = Geometry(cluster_4.smallest_2)
geo_21 = Geometry(item_24)
geo_22 = Geometry(item_23)
geo_23 = Geometry(flatten([geo_18, geo_17, geo_21]))
geo_24 = Geometry(flatten([geo_20, geo_19, geo_22]))
loft_2 = Geometry(loft)
geo_25 = Geometry(geo_24)
geo_26 = Geometry(geo_23)
join_6 = BrepJoin(Breps=flatten([geo_25, loft_2]))  # -> Breps, Closed
join_7 = BrepJoin(Breps=flatten([geo_26, loft_2]))  # -> Breps, Closed
poing_sortant = Geometry(join_7.Breps)
poing_rentrant = Geometry(join_6.Breps)
poing_rentrant_2 = ClusterOutput(poing_rentrant)
poing_sortant_2 = ClusterOutput(poing_sortant)

# ==== cluster Cluster_5
vec = ClusterInput()
num = ClusterInput()
A = ClusterInput()
pt = ClusterInput()
pt_2 = ClusterInput()
vec_2 = Vector(vec)
num_2 = Number(num)
R = ClusterInput()
A_2 = ClusterInput()

amp = Amplitude(Vector=vec_2, Amplitude=A)
pt_3 = Point(pt)
pt_4 = Point(pt_2)
neg = Negative(Value=amp)
move = Move(Geometry=pt_3, Motion=neg)  # -> Geometry, Transform
move_2 = Move(Geometry=pt_4, Motion=amp)  # -> Geometry, Transform
ln = Line(StartPoint=move.Geometry, EndPoint=move_2.Geometry)
circle = CircleCNR(Center=move_2.Geometry, Normal=ln, Radius=num_2)
circle_2 = CircleCNR(Center=move.Geometry, Normal=ln, Radius=R)
circle_3 = CircleCNR(Center=move.Geometry, Normal=ln, Radius=num_2)
amp_2 = Amplitude(Vector=vec_2, Amplitude=A_2)
boundary = BoundarySurfaces(Edges=circle)
boundary_2 = BoundarySurfaces(Edges=circle_3)
boundary_3 = BoundarySurfaces(Edges=circle_2)
neg_2 = Negative(Value=amp_2)
extr = Extrude(Base=boundary, Direction=amp_2)
extr_2 = Extrude(Base=boundary_2, Direction=neg_2)
extr_3 = Extrude(Base=boundary_3, Direction=ln)
sunion = SolidUnion(Breps=[extr, extr_2, extr_3])

R_2 = ClusterOutput(sunion)

# ==== cluster Cluster_7
crv = ClusterInput()
crv_2 = Curve(crv)
runion = RegionUnion(Curves=crv_2)
panel = Panel(runion)

# ---- group: Cull with the length
len = Length(Curve=runion)
len_2 = Length(Curve=crv_2)
int = Integer(len_2)
int_2 = Integer(len)
equals = Equality(FirstNumber=int_2, SecondNumber=int)  # -> Equality, Inequality

# ----
lng = ListLength(List=panel)
dispatch = Dispatch(List=Slider(0, range=0..100), DispatchPattern=lng)  # -> ListA, ListB
panel_2 = Panel(dispatch.ListB)
cull = CullPattern(List=crv_2, CullPattern=equals.Inequality)
vec_inter_extru = ClusterInput()
_5 = ClusterInput()
equals_2 = Equality(FirstNumber=panel_2, SecondNumber=0)  # -> Equality, Inequality
vec_inter_extru_2 = Vector(vec_inter_extru)
in_crv = Curve(cull)
_5_2 = Number(_5)
cull_2 = CullPattern(List=crv_2, CullPattern=equals_2.Equality)
R = ClusterOutput([runion, cull_2])
boundary = BoundarySurfaces(Edges=cull_2)
cluster = Cluster_6(E=in_crv, V=vec_inter_extru_2, A=_5_2)
E = ClusterOutput([cluster, boundary])

# ==== cluster Cluster_8
C = ClusterInput()
end = EndPoints(Curve=C)  # -> Start, End
Z = ClusterInput()
pl = PlaneNormal(Origin=end.Start, ZAxis=Z)
C_2 = ClusterInput()
crv = Curve(C_2)
x_tremez = Extremes(Curve=C_2, Plane=pl)  # -> Highest, Lowest
H = ClusterOutput(x_tremez.Highest)
L = ClusterOutput(x_tremez.Lowest)

# ==== cluster ModifyLnLength
C = ClusterInput()
end = EndPoints(Curve=C)  # -> Start, End
vec2pt = Vector2Pt(PointA=end.Start, PointB=end.End, Unitize=False)  # -> Vector, Length
A = ClusterInput()
A_2 = ClusterInput()
amp = Amplitude(Vector=vec2pt.Vector, Amplitude=A)
amp_2 = Amplitude(Vector=vec2pt.Vector, Amplitude=A_2)
neg = Negative(Value=amp)
move = Move(Geometry=end.Start, Motion=amp_2)  # -> Geometry, Transform
move_2 = Move(Geometry=end.End, Motion=neg)  # -> Geometry, Transform
ln = Line(StartPoint=move.Geometry, EndPoint=move_2.Geometry)
L = ClusterOutput(ln)

# ==== cluster Cluster_9
geo = ClusterInput()
B = ClusterInput()
geo_2 = Geometry(geo)
debrep = DeconstructBrep(Brep=B)  # -> Faces, Edges, Vertices
geo_3 = Geometry(B)
sunion = SolidUnion(Breps=flatten([geo_3, geo_2]))
area = Area(Geometry=debrep.Faces)  # -> Area, Centroid
R = ClusterOutput(sunion)

# ==== cluster CutPoingRentrant
D = ClusterInput()
X = ClusterInput()
poing_rentrant_2 = ClusterInput()
poing_rentrant_1 = ClusterInput()
loft_2 = ClusterInput()
rad = Radians(Degrees=D)
G = ClusterInput()
rotax = RotateAxis(Geometry=G, Angle=rad, Axis=X)  # -> Geometry, Transform
poing_rentrant_1_2 = Geometry(poing_rentrant_1)
rotax_2 = RotateAxis(Geometry=poing_rentrant_1_2, Angle=rad, Axis=X)  # -> Geometry, Transform
poing_rentrant_1_3 = Geometry(rotax_2.Geometry)
poing_rentrant_2_2 = Geometry(poing_rentrant_2)
loft_1_rotated = Brep(rotax.Geometry)
loft_2_2 = Geometry(loft_2)
split = SplitBrep(Brep=loft_1_rotated, Cutter=poing_rentrant_2_2)
split_2 = SplitBrep(Brep=loft_2_2, Cutter=poing_rentrant_1_3)
area = Area(Geometry=split)  # -> Area, Centroid
area_2 = Area(Geometry=split_2)  # -> Area, Centroid
sort = SortList(Keys=area.Area, ValuesA=split)  # -> Keys, ValuesA
sort_2 = SortList(Keys=area_2.Area, ValuesA=split_2)  # -> Keys, ValuesA
item = ListItem(List=sort_2.ValuesA, Index=Slider(-1, range=-1..1), Wrap=True)
cull_i = CullIndex(List=sort.ValuesA, Indices=Slider(-1, range=-1..1), Wrap=True)
join = BrepJoin(Breps=flatten([cull_i, item]))  # -> Breps, Closed
edges = BrepEdges(Brep=join.Breps)  # -> Naked, Interior, NonManifold
join_2 = JoinCurves(Curves=edges.Naked, Preserve=False)
len = Length(Curve=join_2)
tube = ClusterInput()
sort_3 = SortList(Keys=len, ValuesA=join_2)  # -> Keys, ValuesA
tube_2 = Geometry(tube)
item_2 = ListItem(List=sort_3.ValuesA, Index=Slider(1, range=0..1), Wrap=True)

# ---- group: clean little parts
join_3 = JoinCurves(Curves=flatten(item_2), Preserve=False)
len_2 = Length(Curve=join_3)
sort_4 = SortList(Keys=len_2, ValuesA=join_3)  # -> Keys, ValuesA
item_3 = ListItem(List=sort_4.ValuesA, Index=Slider(-1, range=-1..1), Wrap=True)

# ----
debrep = DeconstructBrep(Brep=tube_2)  # -> Faces, Edges, Vertices
item_4 = ListItem(List=debrep.Faces, Index=2, Wrap=True)
item_5 = ListItem(List=debrep.Faces, Index=1, Wrap=True)
item_6 = ListItem(List=debrep.Faces, Index=0, Wrap=True)
geo = Geometry(item_2)
geo_2 = Geometry(item_3)
srfsplit = SurfaceSplit(Surface=item_4, Curves=geo)
explode = Explode(Curve=item_3, Recursive=True)  # -> Segments, Vertices
geo_3 = Geometry(item_2)
geo_4 = Geometry(item_2)
srfsplit_2 = SurfaceSplit(Surface=item_6, Curves=geo_3)
srfsplit_3 = SurfaceSplit(Surface=item_5, Curves=geo_4)
join_broken_parts = JoinBrokenParts_2(fp_curve=geo, brep=srfsplit)  # -> B, B_2
item_7 = ListItem(List=srfsplit_2, Index=0, Wrap=True)
item_8 = ListItem(List=srfsplit_2, Index=1, Wrap=True)
item_9 = ListItem(List=srfsplit_3, Index=0, Wrap=True)
item_10 = ListItem(List=srfsplit_3, Index=1, Wrap=True)
brep = Brep(graft(join_broken_parts.B))
brep_2 = Brep(graft(join_broken_parts.B_2))
brep_3 = Brep(item_7)
brep_4 = Brep(item_8)
brep_5 = Brep(item_9)
brep_6 = Brep(item_10)
area_3 = Area(Geometry=[brep_2, brep])  # -> Area, Centroid
area_4 = Area(Geometry=[brep_4, brep_3])  # -> Area, Centroid
area_5 = Area(Geometry=[brep_6, brep_5])  # -> Area, Centroid
sort_5 = SortList(Keys=area_3.Area, ValuesA=[brep, brep_2])  # -> Keys, ValuesA
sort_6 = SortList(Keys=area_4.Area, ValuesA=[brep_3, brep_4])  # -> Keys, ValuesA
sort_7 = SortList(Keys=area_5.Area, ValuesA=[brep_5, brep_6])  # -> Keys, ValuesA
item_11 = ListItem(List=sort_6.ValuesA, Index=1, Wrap=True)
item_12 = ListItem(List=sort_5.ValuesA, Index=1, Wrap=True)
item_13 = ListItem(List=sort_7.ValuesA, Index=1, Wrap=True)
geo_5 = Geometry(flatten([item_12, item_11, item_13]))
join_4 = BrepJoin(Breps=geo_5)  # -> Breps, Closed
brep_7 = Brep(join.Breps)
join_5 = BrepJoin(Breps=flatten([join_4.Breps, brep_7]))  # -> Breps, Closed
poing_rentrant_cut = Brep(join_5.Breps)
poing_rentrant_cut_2 = ClusterOutput(poing_rentrant_cut)

# ==== cluster CombinePoings
brep = ClusterInput()
brep_2 = ClusterInput()
discs = ClusterInput()
brep_3 = Brep(brep)
brep_4 = Brep(brep_2)
discs_2 = Geometry(discs)
pln = Plane(discs_2)
starting_point = ClusterInput()
bool = ClusterInput()
starting_point_2 = Geometry(starting_point)
bool_2 = Boolean(bool)
bool_3 = Boolean(invert(bool_2))
bool_4 = Boolean(bool_2)
bool_5 = Boolean([bool_4, bool_3])
bool_6 = Boolean(invert(bool_5))

# ---- group: select 1/2 pieces
python = PythonScript(brp=brep_4, pln=pln)  # -> out, pieces; inputs brp: Brep, pln: list of Plane
# ---------- python: Python ----------
import rhinoscriptsyntax as rs
import Rhino as rh
import System as sys
import scriptcontext as sc

""" S
Split Brep plane 2012, 
by Arie-Willem de Jongh
"""


arrBrep =[]
arrBrep.append(brp)

if brp and pln:
    
    bb = rh.Geometry.Brep.GetBoundingBox(brp,rh.Geometry.Plane.WorldXY)
    
    for i in pln:
        bool,extU,extV = rh.Geometry.Plane.ExtendThroughBox(i,bb)
        extU.T0 = extU.T0 - 1
        extU.T1 = extU.T1 + 1
        extV.T0 = extV.T0 - 1
        extV.T1 = extV.T1 + 1
        
        planeSrf = rh.Geometry.PlaneSurface(i,extU,extV)
        splitter = planeSrf.ToBrep()
        arrBrepC = arrBrep[:]
        for j in arrBrepC:
            brep = rs.coercebrep(j)
            tbrep = brep.Split(splitter,0.001)
            if tbrep:
                arrBrep.remove(j)
                for k in tbrep:
                    arrBrep.append(k)

pieces = arrBrep
# ---------- end python ----------
number_slider = Slider(2, range=0..10)

# ---- group: select 1/2 pieces / centroid of each piece
area = Area(Geometry=python.pieces)  # -> Area, Centroid

# ---- group: select 1/2 pieces / create lines of 2 closest points
prox = Proximity3D(Points=area.Centroid, Group=number_slider)  # -> flatten(Links), Topology

# ---- group: select 1/2 pieces
python_2 = PythonScript(brp=brep_3, pln=pln)  # -> out, pieces; inputs brp: Brep, pln: list of Plane; same code as python
number_slider_2 = Slider(2, range=0..10)

# ---- group: select 1/2 pieces / centroid of each piece
area_2 = Area(Geometry=python_2.pieces)  # -> Area, Centroid

# ---- group: select 1/2 pieces / create lines of 2 closest points
prox_2 = Proximity3D(Points=area_2.Centroid, Group=number_slider_2)  # -> flatten(Links), Topology

# ---- group: select 1/2 pieces (continued)
len = Length(Curve=prox.Links)
sort = SortList(Keys=len, ValuesA=prox.Links)  # -> Keys, ValuesA

# ---- group: select 1/2 pieces / select the 2 longest lines
item = ListItem(List=sort.ValuesA, Index=[-1, -2], Wrap=True)

# ---- group: select 1/2 pieces (continued)
len_2 = Length(Curve=prox_2.Links)
sort_2 = SortList(Keys=len_2, ValuesA=prox_2.Links)  # -> Keys, ValuesA

# ---- group: select 1/2 pieces / select the 2 longest lines
item_2 = ListItem(List=sort_2.ValuesA, Index=[-1, -2], Wrap=True)

# ---- group: select 1/2 pieces (continued)
end = EndPoints(Curve=item)  # -> Start, End
dispatch = Dispatch(List=end.Start, DispatchPattern=[True, False])  # -> ListA, ListB
ln = Line(StartPoint=dispatch.ListA, EndPoint=dispatch.ListB)
crv_cp = CurveClosestPoint(Point=area.Centroid, Curve=ln)  # -> Point, Parameter, Distance

# ---- group: select 1/2 pieces / classify the pieces with distance to the starting point
dist = Distance(PointA=starting_point_2, PointB=crv_cp.Point)
sort_3 = SortList(Keys=dist, ValuesA=python.pieces)  # -> Keys, ValuesA

# ---- group: select 1/2 pieces (continued)
geo = Geometry(sort_3.ValuesA)
cull = CullPattern(List=geo, CullPattern=bool_5)

end_2 = EndPoints(Curve=item_2)  # -> Start, End
dispatch_2 = Dispatch(List=end_2.Start, DispatchPattern=[True, False])  # -> ListA, ListB
ln_2 = Line(StartPoint=dispatch_2.ListA, EndPoint=dispatch_2.ListB)
crv_cp_2 = CurveClosestPoint(Point=area_2.Centroid, Curve=ln_2)  # -> Point, Parameter, Distance
end_3 = EndPoints(Curve=ln_2)  # -> Start, End

# ---- group: select 1/2 pieces / classify the pieces with distance to the starting point
dist_2 = Distance(PointA=starting_point_2, PointB=crv_cp_2.Point)
sort_4 = SortList(Keys=dist_2, ValuesA=python_2.pieces)  # -> Keys, ValuesA

# ---- group: select 1/2 pieces (continued)
geo_2 = Geometry(sort_4.ValuesA)
cull_2 = CullPattern(List=geo_2, CullPattern=bool_6)

# ----
brep_5 = Brep([cull_2, cull])
join = BrepJoin(Breps=brep_5)  # -> Breps, Closed
cap = CapHoles(Brep=join.Breps)
B = ClusterOutput(cap)

# ==== cluster Cluster_2
C = ClusterInput()
pt = ClusterInput()
line = Line(C)
radius = ClusterInput()

# ---- group: circle + sphere
eval = EvaluateCurve(Curve=C, Parameter=0.5)  # -> Point, Tangent, Angle
pt_2 = Point(pt)
radius_2 = Number(radius)
ln = Line(StartPoint=pt_2, EndPoint=eval.Point)

# ----
sph = Sphere(Base=pt_2, Radius=radius_2)
sph_2 = Geometry(sph)
num = ClusterInput()
num_2 = Number(num)
crv = ClusterInput()
number_slider = Slider(100, range=0..100)
crv_2 = Curve(crv)
radius_3 = Number(radius_2)

# ---- group: Select part of curve
lnpt = LinePt(Line=line, Point=pt_2)
deplane = DeconstructPlane(Plane=lnpt)  # -> Origin, XAxis, YAxis, ZAxis
end = EndPoints(Curve=C)  # -> Start, End
crv_cp = CurveClosestPoint(Point=[end.Start, end.End], Curve=crv_2)  # -> Point, Parameter, Distance
shatter = Shatter(Curve=crv_2, Parameters=crv_cp.Parameter)

# ---- group: Select part of curve / orient Z axis of plane in inner direction
S = ClusterInput()
cp = PlaneClosestPoint(Point=S, Plane=lnpt)  # -> Point, UVPoint, Distance
smaller = SmallerThan(FirstNumber=cp.Distance, SecondNumber=0)  # -> SmallerThan, OrEqualTo
bool = Boolean(smaller.SmallerThan)
item = ListItem(List=[-1, 1], Index=bool, Wrap=True)

# ---- group: Select part of curve (continued)
multiplication = Multiplication(A=deplane.ZAxis, B=item)
pl = PlaneNormal(Origin=deplane.Origin, ZAxis=multiplication)

cull = CullPattern(List=shatter, CullPattern=[False, True])
cull_2 = CullPattern(List=shatter, CullPattern=[True, False])
eval_2 = EvaluateLength(Curve=cull_2, Length=0.5, Normalized=True)  # -> Point, Tangent, Parameter
eval_3 = EvaluateLength(Curve=cull, Length=0.5, Normalized=True)  # -> Point, Tangent, Parameter
cp_2 = PlaneClosestPoint(Point=eval_2.Point, Plane=pl)  # -> Point, UVPoint, Distance
cp_3 = PlaneClosestPoint(Point=eval_3.Point, Plane=pl)  # -> Point, UVPoint, Distance
larger = LargerThan(FirstNumber=cp_2.Distance, SecondNumber=0)  # -> LargerThan, OrEqualTo
larger_2 = LargerThan(FirstNumber=cp_3.Distance, SecondNumber=0)  # -> LargerThan, OrEqualTo
cull_3 = CullPattern(List=cull_2, CullPattern=larger.LargerThan)
cull_4 = CullPattern(List=cull, CullPattern=larger_2.LargerThan)
crv_profile = Curve([cull_3, cull_4])

# ----
divide = DivideCurve(Curve=crv_profile, Count=num_2, Kinks=False)  # -> Points, Tangents, Parameters
lnpt_2 = LinePt(Line=ln, Point=divide.Points)
shatter_pts = Point(divide.Points)
planesrf = PlaneSurface(Plane=lnpt_2, XSize=number_slider, YSize=number_slider)
shatter_pts_2 = ClusterOutput(shatter_pts)
cir = Circle(Plane=lnpt_2, Radius=radius_3)  # -> graft(Circle)
bcx = BrepCurve(Brep=planesrf, Curve=crv_2)  # -> Curves, Points
tan = TangentLines(Point=bcx.Points, Circle=cir)  # -> Tangent1, Tangent2

# ---- group: project pline on sphere
end_2 = EndPoints(Curve=tan.Tangent1)  # -> Start, End
pt_3 = Point(pt_2)
brep = Brep(sph_2)
pline = PolyLine(Vertices=flatten(end_2.End), Closed=False)
explode = Explode(Curve=pline, Recursive=True)  # -> Segments, Vertices
eval_4 = EvaluateLength(Curve=explode.Segments, Length=0.5, Normalized=True)  # -> Point, Tangent, Parameter
vec2pt = Vector2Pt(PointA=pt_3, PointB=eval_4.Point, Unitize=False)  # -> Vector, Length
project = Project(Curve=explode.Segments, Brep=brep, Direction=vec2pt.Vector)
join = JoinCurves(Curves=flatten(project), Preserve=False)

# ---- group: Select curve on positive side
cull_5 = CullPattern(List=join, CullPattern=[False, True])
cull_6 = CullPattern(List=join, CullPattern=[True, False])
eval_5 = EvaluateLength(Curve=cull_6, Length=0.5, Normalized=True)  # -> Point, Tangent, Parameter
eval_6 = EvaluateLength(Curve=cull_5, Length=0.5, Normalized=True)  # -> Point, Tangent, Parameter
cp_4 = PlaneClosestPoint(Point=eval_5.Point, Plane=pl)  # -> Point, UVPoint, Distance
cp_5 = PlaneClosestPoint(Point=eval_6.Point, Plane=pl)  # -> Point, UVPoint, Distance
larger_3 = LargerThan(FirstNumber=cp_5.Distance, SecondNumber=0)  # -> LargerThan, OrEqualTo
larger_4 = LargerThan(FirstNumber=cp_4.Distance, SecondNumber=0)  # -> LargerThan, OrEqualTo
cull_7 = CullPattern(List=cull_6, CullPattern=larger_4.LargerThan)
cull_8 = CullPattern(List=cull_5, CullPattern=larger_3.LargerThan)
crv_tan = Curve([cull_7, cull_8])

# ---- group: shatter
pt_4 = Point(flatten(end_2.End))
crv_3 = Curve(crv_tan)
crv_cp_2 = CurveClosestPoint(Point=pt_4, Curve=crv_3)  # -> Point, Parameter, Distance
shatter_2 = Shatter(Curve=crv_3, Parameters=crv_cp_2.Parameter)

# ----
crv_profile_2 = ClusterOutput(crv_profile)
S_2 = ClusterOutput(shatter_2)

# ==== cluster SelectPartOfProfile
crv = ClusterInput()
P = ClusterInput()

# ---- group: cut curve
crv_2 = Curve(crv)
crv_cp = CurveClosestPoint(Point=P, Curve=crv_2)  # -> Point, Parameter, Distance
shatter = Shatter(Curve=crv_2, Parameters=crv_cp.Parameter)

# ---- group: select shortest curve
crv_3 = Curve(shatter)
len = Length(Curve=crv_3)
sort = SortList(Keys=len, ValuesA=crv_3)  # -> Keys, ValuesA
item = ListItem(List=sort.ValuesA, Index=0, Wrap=True)

# ----
i = ClusterOutput(item)

# ==== cluster CurveOnTube
C = ClusterInput()
C_2 = ClusterInput()
B = ClusterInput()

# ---- group: project pline on tube
end = EndPoints(Curve=C)  # -> Start, End
pline = PolyLine(Vertices=flatten(end.End), Closed=False)
explode = Explode(Curve=pline, Recursive=True)  # -> Segments, Vertices
eval = EvaluateLength(Curve=explode.Segments, Length=0.5, Normalized=True)  # -> Point, Tangent, Parameter
crv_cp = CurveClosestPoint(Point=eval.Point, Curve=C_2)  # -> Point, Parameter, Distance
vec2pt = Vector2Pt(PointA=crv_cp.Point, PointB=eval.Point, Unitize=False)  # -> Vector, Length
project = Project(Curve=explode.Segments, Brep=B, Direction=vec2pt.Vector)
join = JoinCurves(Curves=flatten(project), Preserve=False)  # disabled

# ----
join_2 = JoinCurves(Curves=flatten(project), Preserve=False)
len = Length(Curve=join_2)
sort = SortList(Keys=len, ValuesA=join_2)  # -> Keys, ValuesA
eval_2 = EvaluateLength(Curve=flatten(project), Length=Slider(0.5, range=0..1), Normalized=True)  # -> Point, Tangent, Parameter
item = ListItem(List=sort.ValuesA, Index=Slider(-1, range=-1..1), Wrap=True)

# ---- group: select longest curve
crv = Curve(join)  # disabled
len_2 = Length(Curve=crv)  # disabled
sort_2 = SortList(Keys=len_2, ValuesA=crv)  # -> Keys, ValuesA; disabled
item_2 = ListItem(List=sort_2.ValuesA, Index=-1, Wrap=True)  # disabled

# ----
dispatch = Dispatch(List=project, DispatchPattern=[True, False])  # -> flatten(ListA), flatten(ListB); disabled
crv_cp_2 = CurveClosestPoint(Point=eval_2.Point, Curve=item)  # -> Point, Parameter, Distance
join_3 = JoinCurves(Curves=dispatch.ListB, Preserve=False)  # disabled
join_4 = JoinCurves(Curves=dispatch.ListA, Preserve=False)  # disabled
smaller = SmallerThan(FirstNumber=crv_cp_2.Distance, SecondNumber=Slider(0.1, range=0..0.1))  # -> SmallerThan, OrEqualTo
lng = ListLength(List=join_3)  # disabled
lng_2 = ListLength(List=join_4)  # disabled
cull = CullPattern(List=flatten(project), CullPattern=smaller.SmallerThan)
larger = LargerThan(FirstNumber=lng_2, SecondNumber=lng)  # -> LargerThan, OrEqualTo; disabled
filter = StreamFilter(Gate=larger.LargerThan, Stream0=dispatch.ListA, Stream1=dispatch.ListB)  # disabled
L = ClusterOutput(cull)

# ==== cluster JoinBrokenParts
brep = ClusterInput()
fp_curve = ClusterInput()
brep_2 = Brep(brep)
fp_curve_2 = Curve(fp_curve)
cull = CullPattern(List=brep_2, CullPattern=[False, True, False])  # -> flatten(List)
cull_2 = CullPattern(List=brep_2, CullPattern=[False, False, True])  # -> flatten(List)
cull_3 = CullPattern(List=brep_2, CullPattern=[True, False, False])  # -> flatten(List)

# ---- group: tuching lines
bcx = BrepCurve(Brep=cull_3, Curve=fp_curve_2)  # -> flatten(Curves), Points
bcx_2 = BrepCurve(Brep=cull, Curve=fp_curve_2)  # -> flatten(Curves), Points
bcx_3 = BrepCurve(Brep=cull_2, Curve=fp_curve_2)  # -> flatten(Curves), Points

# ----
join = JoinCurves(Curves=bcx_2.Curves, Preserve=False)
join_2 = JoinCurves(Curves=bcx.Curves, Preserve=False)
join_3 = JoinCurves(Curves=bcx_3.Curves, Preserve=False)

# ---- group: number of lines
lng = ListLength(List=join_3)
lng_2 = ListLength(List=join_2)
lng_3 = ListLength(List=join)

# ----
cluster = Cluster_3(A=lng_2, A_2=lng_3, B=lng)  # -> larger_than, smaller_than
cluster_2 = Cluster_3(A=lng, A_2=lng_2, B=lng_3)  # -> larger_than, smaller_than
cluster_3 = Cluster_3(A=lng_3, A_2=lng_2, B=lng)  # -> larger_than, smaller_than
cull_4 = CullPattern(List=cull_3, CullPattern=cluster.larger_than)
cull_5 = CullPattern(List=cull, CullPattern=cluster_3.larger_than)
cull_6 = CullPattern(List=cull_2, CullPattern=cluster_2.larger_than)
cull_7 = CullPattern(List=cull_3, CullPattern=cluster.smaller_than)
cull_8 = CullPattern(List=cull, CullPattern=cluster_3.smaller_than)
cull_9 = CullPattern(List=cull_2, CullPattern=cluster_2.smaller_than)
join_4 = BrepJoin(Breps=[cull_6, cull_5, cull_4])  # -> Breps, Closed
join_5 = BrepJoin(Breps=[cull_9, cull_8, cull_7])  # -> Breps, Closed
B = ClusterOutput(join_4.Breps)
B_2 = ClusterOutput(join_5.Breps)

# ==== cluster Cluster_4
C = ClusterInput()
S = ClusterInput()
geo = Geometry(S)
geo_2 = Geometry(C)
srfsplit = SurfaceSplit(Surface=S, Curves=C)
area = Area(Geometry=srfsplit)  # -> Area, Centroid
sort = SortList(Keys=area.Area, ValuesA=srfsplit)  # -> Keys, ValuesA
item = ListItem(List=sort.ValuesA, Index=Slider(0, range=0..1), Wrap=True)
item_2 = ListItem(List=sort.ValuesA, Index=Slider(1, range=0..1), Wrap=True)
smallest = Geometry(item)
biggest = Geometry(item_2)
smallest_2 = ClusterOutput(smallest)
biggest_2 = ClusterOutput(biggest)

# ==== cluster PartitionedLoft
from_curve_on_tube = ClusterInput()
from_select_part_of_profile = ClusterInput()
shatter_pt = ClusterInput()
from_curve_on_tube_2 = Geometry(from_curve_on_tube)
from_select_part_of_profile_2 = Geometry(from_select_part_of_profile)
end = EndPoints(Curve=from_select_part_of_profile_2)  # -> Start, End
item = ListItem(List=from_curve_on_tube_2, Index=0, Wrap=True)
shatter_pt_2 = Point(shatter_pt)
crv_cp = CurveClosestPoint(Point=end.Start, Curve=item)  # -> Point, Parameter, Distance
crv_cp_2 = CurveClosestPoint(Point=end.End, Curve=item)  # -> Point, Parameter, Distance
flip = FlipCurve(Curve=from_select_part_of_profile_2)  # -> Curve, Flag
larger = LargerThan(FirstNumber=crv_cp.Distance, SecondNumber=crv_cp_2.Distance)  # -> LargerThan, OrEqualTo
geo = Geometry(from_select_part_of_profile_2)
filter = StreamFilter(Gate=larger.LargerThan, Stream0=geo, Stream1=flip.Curve)
geo_2 = Geometry(filter)
crv_cp_3 = CurveClosestPoint(Point=shatter_pt_2, Curve=geo_2)  # -> Point, Parameter, Distance
shatter = Shatter(Curve=geo_2, Parameters=crv_cp_3.Parameter)
weave = Weave(Pattern=[0, 1], Stream0=graft(from_curve_on_tube_2), Stream1=graft(shatter), NullGaps=False)
loft = Loft(Curves=weave, Options={Adjust=False, Closed=False, LoftEnds=0, LoftSimp=0, LoftType=0, Rebuild=10, Refit=0.01})
join = BrepJoin(Breps=flatten(loft))  # -> Breps, Closed
B = ClusterOutput(join.Breps)

# ==== cluster Cluster_6
E = ClusterInput()
V = ClusterInput()
A = ClusterInput()
boundary = BoundarySurfaces(Edges=E)
amp = Amplitude(Vector=V, Amplitude=A)
addition = Addition(A=A, B=Slider(0.1, range=0..1))
move = Move(Geometry=boundary, Motion=amp)  # -> Geometry, Transform
neg = Negative(Value=addition)
amp_2 = Amplitude(Vector=V, Amplitude=neg)
extr = Extrude(Base=move.Geometry, Direction=amp_2)
E_2 = ClusterOutput(extr)

# ==== cluster JoinBrokenParts_2
brep = ClusterInput()
brep_2 = Brep(brep)
area = Area(Geometry=brep_2)  # -> Area, Centroid
brep_3 = Brep(brep)
fp_curve = ClusterInput()
panel = Panel(area.Area)
fp_curve_2 = Curve(fp_curve)
cull = CullPattern(List=brep_3, CullPattern=[False, False, True])  # -> flatten(List)
cull_2 = CullPattern(List=brep_3, CullPattern=[True, False, False])  # -> flatten(List)
cull_3 = CullPattern(List=brep_3, CullPattern=[False, True, False])  # -> flatten(List)

# ---- group: tuching lines
bcx = BrepCurve(Brep=cull_2, Curve=fp_curve_2)  # -> flatten(Curves), Points
bcx_2 = BrepCurve(Brep=cull_3, Curve=fp_curve_2)  # -> flatten(Curves), Points
bcx_3 = BrepCurve(Brep=cull, Curve=fp_curve_2)  # -> flatten(Curves), Points

# ----
join = JoinCurves(Curves=bcx_2.Curves, Preserve=False)
join_2 = JoinCurves(Curves=bcx.Curves, Preserve=False)
join_3 = JoinCurves(Curves=bcx_3.Curves, Preserve=False)

# ---- group: number of lines
lng = ListLength(List=join_3)
lng_2 = ListLength(List=join_2)
lng_3 = ListLength(List=join)

# ----
cluster = Cluster_3(A=lng_2, A_2=lng_3, B=lng)  # -> larger_than, smaller_than
cluster_2 = Cluster_3(A=lng, A_2=lng_2, B=lng_3)  # -> larger_than, smaller_than
cluster_3 = Cluster_3(A=lng_3, A_2=lng_2, B=lng)  # -> larger_than, smaller_than
cull_4 = CullPattern(List=cull_2, CullPattern=cluster.larger_than)
cull_5 = CullPattern(List=cull_3, CullPattern=cluster_3.larger_than)
cull_6 = CullPattern(List=cull, CullPattern=cluster_2.larger_than)
cull_7 = CullPattern(List=cull_2, CullPattern=cluster.smaller_than)
cull_8 = CullPattern(List=cull_3, CullPattern=cluster_3.smaller_than)
cull_9 = CullPattern(List=cull, CullPattern=cluster_2.smaller_than)
join_4 = BrepJoin(Breps=[cull_6, cull_5, cull_4])  # -> Breps, Closed
join_5 = BrepJoin(Breps=[cull_9, cull_8, cull_7])  # -> Breps, Closed
B = ClusterOutput(join_4.Breps)
B_2 = ClusterOutput(join_5.Breps)

# ==== cluster Cluster_3
A = ClusterInput()
A_2 = ClusterInput()
B = ClusterInput()
addition = Addition(A=A, B=Slider(1, range=0..1))
addition_2 = Addition(A=A_2, B=B)
larger = LargerThan(FirstNumber=addition, SecondNumber=addition_2)  # -> LargerThan, OrEqualTo
smaller = SmallerThan(FirstNumber=addition, SecondNumber=addition_2)  # -> SmallerThan, OrEqualTo
smaller_than = ClusterOutput(smaller.SmallerThan)
larger_than = ClusterOutput(larger.LargerThan)
